# Grasshopper definition Script-W-64-64-64-Oana-080622-mihal_a-1-100-model only.gh (Grasshopper 1.0.7)
# plug-ins: LunchBox

xy_plane = XYPlane(Origin=Point(0, 0, 0))
negative = Negative(Value="1")
rectangle = Rectangle(Plane=xy_plane, XSize="64", YSize="64", Radius=0)  # -> Rectangle, Length
unit_z = UnitZ(Factor=negative)
boundary_surfaces = BoundarySurfaces(Edges=rectangle.Rectangle)

# ---- group: ANIMATE ME
number_slider = Slider(206, range=106..206)

# ----
extrude = Extrude(Base=boundary_surfaces, Direction=unit_z)
deconstruct_brep = DeconstructBrep(Brep=boundary_surfaces)  # -> Faces, Edges, Vertices
number_slider_2 = Slider(30, range=0..255)
number_slider_3 = Slider(185, range=145..255)
Z = Slider(36, range=5..60)
rebuild_surface = RebuildSurface(Surface=boundary_surfaces, UDegree="3", VDegree="3", UNumber="16", VNumber="16")
Z_2 = Slider(34, range=5..60)
number_slider_4 = Slider(22, range=5..60)
Z_3 = Slider(60, range=5..60)
Z_4 = Slider(16, range=5..60)
Z_5 = Slider(44, range=5..60)
surface_points = SurfacePoints(Surface=rebuild_surface)  # -> Points, Weights, Greville, UCount, VCount
addition = Addition(A=number_slider_3, B=Slider(41, range=0..255))
addition_2 = Addition(A=addition, B=Slider(247, range=0..1000))
point_list = PointList(Points=surface_points.Points, Size=Slider(0.5, range=0..1))
addition_3 = Addition(A=addition, B="16")
addition_4 = Addition(A=number_slider_3, B="16")
addition_5 = Addition(A=addition_2, B="16")
addition_6 = Addition(A=addition, B=number_slider)
addition_7 = Addition(A=number_slider_3, B=number_slider)
addition_8 = Addition(A=addition_2, B=number_slider)
addition_9 = Addition(A=addition_8, B="1")
addition_10 = Addition(A=addition_8, B="16")
addition_11 = Addition(A=addition_10, B="16")
addition_12 = Addition(A=addition_9, B="1")
addition_13 = Addition(A=addition_11, B="16")
addition_14 = Addition(A=addition_12, B="1")
list_item = ListItem(
    List=surface_points.Points,
    Index=[number_slider_3, addition_2, addition, addition_7, addition_6, addition_8, addition_9, addition_12, addition_14, addition_10, addition_11, addition_13, addition_4, addition_3, addition_5],
    Wrap=True)
addition_15 = Addition(A=number_slider_4, B=Slider(8, range=5..20))
addition_16 = Addition(A=Z_5, B=Slider(12, range=5..20))
addition_17 = Addition(A=number_slider_4, B=Slider(5, range=5..20))
addition_18 = Addition(A=Z_4, B=Slider(11, range=5..20))
addition_19 = Addition(A=Z, B=Slider(12, range=5..20))
addition_20 = Addition(A=Z, B=Slider(12, range=5..20))
addition_21 = Addition(A=Z, B=Slider(12, range=5..20))
addition_22 = Addition(A=Z, B=Slider(12, range=5..20))
addition_23 = Addition(A=Z, B=Slider(12, range=5..20))
addition_24 = Addition(A=Z_2, B=Slider(9, range=5..20))
addition_25 = Addition(A=Z_2, B=Slider(6, range=5..20))
addition_26 = Addition(A=Z_2, B=Slider(10, range=5..20))
unit_z_2 = UnitZ(Factor=number_slider_4)
unit_z_3 = UnitZ(Factor=addition_17)
unit_z_4 = UnitZ(Factor=addition_18)
unit_z_5 = UnitZ(Factor=addition_15)
unit_z_6 = UnitZ(Factor=addition_16)
unit_z_7 = UnitZ(Factor=Z_3)
unit_z_8 = UnitZ(Factor=addition_19)
unit_z_9 = UnitZ(Factor=addition_20)
unit_z_10 = UnitZ(Factor=addition_21)
unit_z_11 = UnitZ(Factor=Z)
unit_z_12 = UnitZ(Factor=addition_22)
unit_z_13 = UnitZ(Factor=addition_23)
unit_z_14 = UnitZ(Factor=addition_24)
unit_z_15 = UnitZ(Factor=addition_25)
unit_z_16 = UnitZ(Factor=addition_26)
point_deform = PointDeform(
    Geometry=rebuild_surface,
    Points=list_item,
    Motion=[unit_z_7, unit_z_4, unit_z_6, unit_z_2, unit_z_3, unit_z_5, unit_z_11, unit_z_9, unit_z_8, unit_z_10, unit_z_13, unit_z_12, unit_z_14, unit_z_16, unit_z_15])
mesh = Mesh(point_deform)
xz_plane = XZPlane(Origin=Point(0, 0, 0))
rotate = Rotate(Geometry=mesh, Angle=degrees(Slider(90, range=0..100)), Plane=xz_plane)  # -> Geometry, Transform
unit_x = UnitX(Factor="64")
move = Move(Geometry=rotate.Geometry, Motion=unit_x)  # -> Geometry, Transform
list_item_2 = ListItem(List=deconstruct_brep.Vertices, Index="0", Wrap=True)
unit_y = UnitY(Factor=1)
contour = Contour(Shape=[move.Geometry, point_deform], Point=list_item_2, Direction=unit_y, Distance="2")
unit_y_2 = UnitY(Factor="1")
extrude_2 = Extrude(Base=contour, Direction=unit_y_2)
