# Grasshopper definition Script-W-64-64-64-Oana-080622-mihal_a-1-200--.gh (Grasshopper 1.0.7)
# plug-ins: LunchBox, Volvox, NGon, Pufferfish, Kangaroo2 Components

# ---- group: ANIMATE ME
number_slider = Slider(200, range=0..200)

# ----
xy_plane = XYPlane(Origin=Point(0, 0, 0))
negative = Negative(Value="1")
rectangle = Rectangle(Plane=xy_plane, XSize="64", YSize="64", Radius=0)  # -> Rectangle, Length
unit_z = UnitZ(Factor=negative)
boundary_surfaces = BoundarySurfaces(Edges=rectangle.Rectangle)
extrude = Extrude(Base=boundary_surfaces, Direction=unit_z)
deconstruct_brep = DeconstructBrep(Brep=boundary_surfaces)  # -> Faces, Edges, Vertices
number_slider_2 = Slider(185, range=145..255)
Z = Slider(36, range=5..60)
number_slider_3 = Slider(73, range=0..255)
rebuild_surface = RebuildSurface(Surface=boundary_surfaces, UDegree="3", VDegree="3", UNumber="16", VNumber="16")
Z_2 = Slider(34, range=5..60)
number_slider_4 = Slider(22, range=5..60)
Z_3 = Slider(60, range=5..60)
Z_4 = Slider(16, range=5..60)
Z_5 = Slider(44, range=5..60)
surface_points = SurfacePoints(Surface=rebuild_surface)  # -> Points, Weights, Greville, UCount, VCount
addition = Addition(A=number_slider, B=Slider(41, range=0..255))
addition_2 = Addition(A=addition, B=Slider(247, range=0..1000))
point_list = PointList(Points=surface_points.Points, Size=Slider(0.5, range=0..1))
addition_3 = Addition(A=addition, B="16")
addition_4 = Addition(A=number_slider, B="16")
addition_5 = Addition(A=addition_2, B="16")
addition_6 = Addition(A=addition, B=number_slider_3)
addition_7 = Addition(A=number_slider, B=number_slider_3)
addition_8 = Addition(A=addition_2, B=number_slider_3)
addition_9 = Addition(A=addition_8, B="1")
addition_10 = Addition(A=addition_8, B="16")
addition_11 = Addition(A=addition_10, B="16")
addition_12 = Addition(A=addition_9, B="1")
addition_13 = Addition(A=addition_11, B="16")
addition_14 = Addition(A=addition_12, B="1")
list_item = ListItem(
    List=surface_points.Points,
    Index=[number_slider, addition_2, addition, addition_7, addition_6, addition_8, addition_9, addition_12, addition_14, addition_10, addition_11, addition_13, addition_4, addition_3, addition_5],
    Wrap=True)
addition_15 = Addition(A=number_slider_4, B=Slider(8, range=5..20))
addition_16 = Addition(A=Z_5, B=Slider(12, range=5..20))
addition_17 = Addition(A=number_slider_4, B=Slider(5, range=5..20))
addition_18 = Addition(A=Z_4, B=Slider(11, range=5..20))
addition_19 = Addition(A=Z, B=Slider(12, range=5..20))
addition_20 = Addition(A=Z, B=Slider(12, range=5..20))
addition_21 = Addition(A=Z, B=Slider(12, range=5..20))
addition_22 = Addition(A=Z, B=Slider(12, range=5..20))
addition_23 = Addition(A=Z, B=Slider(12, range=5..20))
addition_24 = Addition(A=Z_2, B=Slider(9, range=5..20))
addition_25 = Addition(A=Z_2, B=Slider(6, range=5..20))
addition_26 = Addition(A=Z_2, B=Slider(10, range=5..20))
unit_z_2 = UnitZ(Factor=number_slider_4)
unit_z_3 = UnitZ(Factor=addition_17)
unit_z_4 = UnitZ(Factor=addition_18)
unit_z_5 = UnitZ(Factor=addition_15)
unit_z_6 = UnitZ(Factor=addition_16)
unit_z_7 = UnitZ(Factor=Z_3)
unit_z_8 = UnitZ(Factor=addition_19)
unit_z_9 = UnitZ(Factor=addition_20)
unit_z_10 = UnitZ(Factor=addition_21)
unit_z_11 = UnitZ(Factor=Z)
unit_z_12 = UnitZ(Factor=addition_22)
unit_z_13 = UnitZ(Factor=addition_23)
unit_z_14 = UnitZ(Factor=addition_24)
unit_z_15 = UnitZ(Factor=addition_25)
unit_z_16 = UnitZ(Factor=addition_26)
point_deform = PointDeform(
    Geometry=rebuild_surface,
    Points=list_item,
    Motion=[unit_z_7, unit_z_4, unit_z_6, unit_z_2, unit_z_3, unit_z_5, unit_z_11, unit_z_9, unit_z_8, unit_z_10, unit_z_13, unit_z_12, unit_z_14, unit_z_16, unit_z_15])
mesh = Mesh(point_deform)
xz_plane = XZPlane(Origin=Point(0, 0, 0))
rotate = Rotate(Geometry=mesh, Angle=degrees(Slider(90, range=0..100)), Plane=xz_plane)  # -> Geometry, Transform
unit_x = UnitX(Factor="64")
move = Move(Geometry=rotate.Geometry, Motion=unit_x)  # -> Geometry, Transform
list_item_2 = ListItem(List=deconstruct_brep.Vertices, Index="0", Wrap=True)
unit_y = UnitY(Factor=1)
contour = Contour(Shape=[move.Geometry, point_deform], Point=list_item_2, Direction=unit_y, Distance="2")
unit_y_2 = UnitY(Factor="1")
extrude_2 = Extrude(Base=contour, Direction=unit_y_2)
mesh_2 = Mesh([point_deform, extrude_2])
relay = Relay()

# ---- group: FOR REMESHING AND EXTRACTING POINTS
mesh_3 = Mesh(mesh_2)
quad_remesh_settings = QuadRemeshSettings(
    TargetCount=Slider(500, range=0..1000),
    AdaptiveSize=0,
    AdaptiveCount=False,
    HardEdges=False,
    SeamEdges=0,
    Symmetry=0,
    GuideCurves=0)
clean = CombineClean(Meshes=mesh_3)
quad_remesh = QuadRemesh(Mesh=clean, Guides=relay, Settings=quad_remesh_settings)

# ----
pt = ConstructPoint(XCoordinate=0, YCoordinate=0, ZCoordinate=0)

# ---- group: FOR REMESHING AND EXTRACTING POINTS
medges = MeshEdges(Mesh=clean)  # -> NakedEdges, InteriorEdges, NonManifoldEdges
nv = NakedVertices(Mesh=quad_remesh)  # -> ClothedIndex, NakedIndex, ClothedPts, NakedPts
join = JoinCurves(Curves=medges.NakedEdges, Preserve=False)
# Add all your design parameters
# Path and name to save CSV file
pt_2 = Point(flatten(nv.ClothedPts))
divide = DivideCurve(Curve=join, Count=Slider(12, range=0..100), Kinks=False)  # -> Points, Tangents, Parameters

# ----
cgrid = CloudGrid(Plane=pt, Size="1", ExtentX="64", ExtentY="64", ExtentZ="64")
cp = ClosestPoint(Cloud=cgrid, Point=pt_2)  # -> Point, Normal, Color, Distance, Index
cset = CreateSet(List=cp.Index)  # -> Set, Map
cloudstats = CloudStatistics(Cloud=cgrid)  # -> P, C, N
number_slider_5 = Slider(0, range=0..100)
series = Series(Start=number_slider_5, Step=number_slider_5, Count=cloudstats.P)
replace = ReplaceItems(List=series, Item=Slider(1, range=0..1), Indices=cset.Set, Wrap=False)
create_set = CreateSet(List=replace)  # -> Set, Map
member_index = MemberIndex(Set=replace, Member=create_set.Set)  # -> Index, Count
lng = ListLength(List=replace)
panel = Panel(lng)
# SET TO TRUE BEFORE YOU ANIMATE
panel_2 = Panel(replace)
panel_3 = Panel(number_slider)
panel_4 = Panel("""A
B
C
D
E
F""")
block_index = Slider(4, range=0..25)
item = ListItem(List=Slider(1, range=1..100), Index=0, Wrap=True)
item_2 = ListItem(List=panel_4, Index=block_index, Wrap=True)
panel_5 = Panel(item)
panel_6 = Panel(item_2)
path = FilePath("C:\Users\Dell\Downloads\IAAC-AIA\2-AIA-GENERATIVE-Oana\DATASET-01\Dir1\")
concat = Concatenate(FragmentC="Iteration", FragmentD="-", FragmentA=panel_5, FragmentE="-", FragmentB=panel_3)
# Create your parametric design here
voxel_data_to_write = Data(replace)
format = Format(Format=concat, Culture=127)
concat_2 = Concatenate(FragmentA=path, FragmentB=format)
write_dataset_files = BooleanToggle(True)
panel_7 = Panel(concat_2)
python = FileCreator(path=path, name=format, ext="txt", lines=voxel_data_to_write, write=write_dataset_files)  # inputs lines: list, write: Boolean
# ---------- python: Python ----------
"""
Creates a file with a given ndame and extension.
    Inputs:
        name: Desired file name.
        ext: Desired file extension.
        lines: Text to write.
        write: Set to True to write.
"""

# Stephen P. Maher /  2015

ghenv.Component.Name = "File Creator"

import Grasshopper as gh
import os

gh_path = ghdoc.Path # Get GH file path
filepath = path # Get GH file directory to save to
#filepath = os.path.dirname(os.path.realpath(gh_path)) # Get GH file directory to save to
print (filepath)

if "." not in ext: ext = "." + ext
else: pass

file = name + ext

if os.path.exists(filepath +file) == False: # Test if file already exists; if it doesn't, proceed
    print ('file created')
    file = name + ext # Set file name and extension
if os.path.exists(filepath + '/'+file) == True: # If it does exists, follow the next steps
    file_count = len([f for f in os.walk(".").next()[2] if f[-4:] == ext]) # Find all files with the same extension
    file = name + "_" + str(file_count) + ext # Add the number to the new file name as a differentiator

if write:
    filePath = open(filepath +file, "w") # Open the file
    for line in lines: # Iterate through lines
        filePath.write(line + "\n") # Write separate lines
    filePath.close() # Close the file
else:
    msg = "Set 'write' to True."
    ghenv.Component.AddRuntimeMessage(gh.Kernel.GH_RuntimeMessageLevel.Warning, msg)
# ---------- end python ----------

# ---- group: DISPLAY
voxels = Voxels(Points=cp.Point, Scale=1)
decloud = DeconstructCloud(Cloud=cgrid)  # -> Points, Normals, Colors
cloud = CloudDisplay(Points=decloud.Points, Colours=RGB(255, 20, 147), Size=".01", SpriteType=0)

# ----
mjoin = MeshJoin(Meshes=flatten(voxels))

# ---- group: DISPLAY (continued)
rebmsh = RebuildMesh(
    Mesh=flatten(mjoin),
    RebuildNormals=invert(False),
    CullUnused=False,
    UnifyNormals=False,
    FlipNormals=False,
    IdenticalCombine=False,
    WeldVertices=0)
preview = CustomPreview(Geometry=rebmsh, Material=ColourSwatch(SwatchColor=RGB(85, 91, 255)))
